# Requirement set HLR_ModeLogic (R2025b)

## 1 [3] Modes of Operation
The quadcopter shall have the following 8 modes of operation:
- Establish Communications
- Initialization
- Calibrate Sensors
- Ready for Flight
- Track Altitude
- Track Altitude and Position
- Lost Ball
- Land
- Crash
The requirements for each of the modes is described in the following sections.

## 2 [16] Establish Communications (Container)

### 2.1 [17] Enter Establish Communications at Power Up
The Establish Communications mode shall be entered upon power up of the flight control system.

### 2.2 [18] Enter Establish Communications from Crash
The Establish Communications mode shall also be entered from the crash mode.

### 2.3 [19] Enter Establish Communications from Land
The Establish Communications mode shall also be entered from the Land mode when the quadcopter's roll angle is less than 5 deg, pitch angle is less than 5 deg, and vertical velocity less than 0.1 m/s.

## 3 [21] Initialization (Container)

### 3.1 [22] Enter Initialization from Establish Communications
The Initialization mode shall be entered from the Establish Communications mode when WIFI communications with the ground station and Bluetooth LE communications with the payload processor are both established.

## 4 [25] Calibrate the Sensors (Container)

### 4.1 [26] Enter Calibrate Sensors from Initialization
The Calibrate Sensors mode shall be entered from the Initialization mode when commanded by the ground station.

### 4.2 [27] Enter Calibrate Sensors from Ready for Flight
The Calibrate Sensors mode shall be entered from the Ready for Flight mode when commanded by the ground station.

## 5 [29] Ready for Flight (Container)

### 5.1 [30] Enter Ready for Flight from Calibration
The Ready for Flight mode shall be entered from the Calibrate Sensors mode once the sensors have completed calibration and the ground station command for the mode is received.

## 6 [33] Track Altitude (Container)

### 6.1 [34] Enter Track Altitude from Ready for Flight
The Track Altitude mode shall be entered from the Ready for Flight when a ball has been sensed to be in view of the camera.

### 6.2 [35] Enter Track Altitude from Lost Ball
The Track Altitude mode shall be entered from the Lost Ball mode when a ball has been sensed to be in view of the camera and the quadcopter is less than 10cm AGL.

## 7 [37] Track Altitude and Position (Container)

### 7.1 [38] The Track Altitude and Position mode shall be entered only from th...
The Track Altitude and Position mode shall be entered from the Track Altitude mode when the quadcopter is at or above 10cm AGL.

### 7.2 [39] The Track Altitude and Position mode shall be entered only from th...
The Track Altitude and Position mode shall be entered from the Lost Ball mode when the ball has been sensed to be in view of the camera and the quadcopter is at or above 10cm AGL.

## 8 [41] Lost Ball (Container)

### 8.1 [42] Enter Lost Ball from Track Altitude
The Lost Ball mode shall be entered from the Track Altitude mode when a ball that was sensed to be in the field of view of the camera is no longer sensed to be in the field of view of the camera.

### 8.2 [43] Enter Lost Ball from Track Altitude and Position
The Lost Ball mode shall be entered from the Track Altitude and Position mode when a ball that was sensed to be in the field of view of the camera is no longer sensed to be in the field of view of the camera.

## 9 [46] Land (Container)

### 9.1 [44] Enter Land from Lost Ball
The Land mode shall be entered from the Lost Ball mode when the quadcopter has been in Lost Ball mode for 3 seconds.

### 9.2 [47] Enter Land from Track Altitude
The Land mode shall be entered from the Track Altitude mode when commanded by the ground station or if the battery voltage goes below 3.0 volts.

### 9.3 [48] Enter Land from Track Altitude and Position
The Land mode shall be entered from the Track Altitude and Position mode when commanded by the ground station or if the battery voltage goes below 3.0 volts.

## 10 [50] Crash (Container)

### 10.1 [51] Enter Crash
The Crash mode shall be entered from any flight mode when commanded by the ground station or if the pitch or roll attitudes exceed 80 degrees while in any flight mode.

## 11 [#56] Justifications (Justification)

### 11.1 [#57] Verified By Inspection (Justification)
This Requirement is to be Verified by Inspection