% Requirement links of ModeLogic.slx (R2025b)

block :4 implements HLR_ModeLogic.slreqx#1: 3: Modes of Operation
block :4:1 implements HLR_ModeLogic.slreqx#1: 3: Modes of Operation
block :4:1 implements HLR_ModeLogic.slreqx#4: 17: Enter Establish Communications at Power Up
block :4:1 implements HLR_ModeLogic.slreqx#5: 18: Enter Establish Communications from Crash
block :4:1 implements HLR_ModeLogic.slreqx#47: 19: Enter Establish Communications from Land
block :4:102 implements HLR_ModeLogic.slreqx#48: 35: Enter Track Altitude from Lost Ball
block :4:102 implements HLR_ModeLogic.slreqx#49: 39: The Track Altitude and Position mode shall be entered only from th...
block :4:103 implements HLR_ModeLogic.slreqx#48: 35: Enter Track Altitude from Lost Ball
block :4:104 implements HLR_ModeLogic.slreqx#49: 39: The Track Altitude and Position mode shall be entered only from th...
block :4:106 implements HLR_ModeLogic.slreqx#42: 51: Enter Crash
block :4:16 implements HLR_ModeLogic.slreqx#1: 3: Modes of Operation
block :4:16 implements HLR_ModeLogic.slreqx#30: 43: Enter Land from Lost Ball
block :4:16 implements HLR_ModeLogic.slreqx#34: 47: Enter Land from Track Altitude
block :4:16 implements HLR_ModeLogic.slreqx#51: 47: Enter Land from Track Altitude and Position
block :4:2 implements HLR_ModeLogic.slreqx#4: 17: Enter Establish Communications at Power Up
block :4:23 implements HLR_ModeLogic.slreqx#1: 3: Modes of Operation
block :4:23 implements HLR_ModeLogic.slreqx#42: 51: Enter Crash
block :4:24 implements HLR_ModeLogic.slreqx#5: 18: Enter Establish Communications from Crash
block :4:25 implements HLR_ModeLogic.slreqx#42: 51: Enter Crash
block :4:29 implements HLR_ModeLogic.slreqx#1: 3: Modes of Operation
block :4:29 implements HLR_ModeLogic.slreqx#25: 38: The Track Altitude and Position mode shall be entered only from th...
block :4:29 implements HLR_ModeLogic.slreqx#49: 39: The Track Altitude and Position mode shall be entered only from th...
block :4:3 implements HLR_ModeLogic.slreqx#1: 3: Modes of Operation
block :4:3 implements HLR_ModeLogic.slreqx#9: 22: Enter Initialization from Establish Communications
block :4:30 implements HLR_ModeLogic.slreqx#25: 38: The Track Altitude and Position mode shall be entered only from th...
block :4:4 implements HLR_ModeLogic.slreqx#9: 22: Enter Initialization from Establish Communications
block :4:5 implements HLR_ModeLogic.slreqx#1: 3: Modes of Operation
block :4:5 implements HLR_ModeLogic.slreqx#17: 30: Enter Ready for Flight from Calibration
block :4:50 implements HLR_ModeLogic.slreqx#50: 42: Enter Lost Ball from Track Altitude and Position
block :4:50 implements HLR_ModeLogic.slreqx#51: 47: Enter Land from Track Altitude and Position
block :4:7 implements HLR_ModeLogic.slreqx#1: 3: Modes of Operation
block :4:7 implements HLR_ModeLogic.slreqx#21: 34: Enter Track Altitude from Ready for Flight
block :4:7 implements HLR_ModeLogic.slreqx#48: 35: Enter Track Altitude from Lost Ball
block :4:74 implements HLR_ModeLogic.slreqx#1: 3: Modes of Operation
block :4:74 implements HLR_ModeLogic.slreqx#13: 26: Enter Calibrate Sensors from Initialization
block :4:74 implements HLR_ModeLogic.slreqx#45: 27: Enter Calibrate Sensors from Ready for Flight
block :4:76 implements HLR_ModeLogic.slreqx#13: 26: Enter Calibrate Sensors from Initialization
block :4:77 implements HLR_ModeLogic.slreqx#17: 30: Enter Ready for Flight from Calibration
block :4:78 implements HLR_ModeLogic.slreqx#45: 27: Enter Calibrate Sensors from Ready for Flight
block :4:79 implements HLR_ModeLogic.slreqx#34: 47: Enter Land from Track Altitude
block :4:79 implements HLR_ModeLogic.slreqx#51: 47: Enter Land from Track Altitude and Position
block :4:8 implements HLR_ModeLogic.slreqx#21: 34: Enter Track Altitude from Ready for Flight
block :4:81 implements HLR_ModeLogic.slreqx#29: 42: Enter Lost Ball from Track Altitude
block :4:81 implements HLR_ModeLogic.slreqx#34: 47: Enter Land from Track Altitude
block :4:84 implements HLR_ModeLogic.slreqx#42: 51: Enter Crash
block :4:85 implements HLR_ModeLogic.slreqx#42: 51: Enter Crash
block :4:88 implements HLR_ModeLogic.slreqx#47: 19: Enter Establish Communications from Land
block :4:93 implements HLR_ModeLogic.slreqx#42: 51: Enter Crash
block :4:96 implements HLR_ModeLogic.slreqx#5: 18: Enter Establish Communications from Crash
block :4:96 implements HLR_ModeLogic.slreqx#47: 19: Enter Establish Communications from Land
block :4:97 implements HLR_ModeLogic.slreqx#1: 3: Modes of Operation
block :4:97 implements HLR_ModeLogic.slreqx#29: 42: Enter Lost Ball from Track Altitude
block :4:97 implements HLR_ModeLogic.slreqx#50: 42: Enter Lost Ball from Track Altitude and Position
block :4:98 implements HLR_ModeLogic.slreqx#29: 42: Enter Lost Ball from Track Altitude
block :4:98 implements HLR_ModeLogic.slreqx#50: 42: Enter Lost Ball from Track Altitude and Position
block :4:99 implements HLR_ModeLogic.slreqx#30: 43: Enter Land from Lost Ball