test file "ModeLogic_HLR_Tests"

suite "Req_2"

  case "2a" [simulation]
    model ModeLogic, harness HLR_02a_complete

  case "2b" [simulation]
    model ModeLogic, harness HLR_02b

suite "Req_3"

suite "Req_4"

  case "4" [simulation]
    model ModeLogic, harness HLR_04

suite "Req_5"

  case "5" [simulation]
    model ModeLogic, harness HLR_05

suite "Req_6"

  case "6" [simulation]
    model ModeLogic, harness HLR_06

suite "Req_7"

  case "7" [simulation]
    model ModeLogic, harness HLR_07

suite "Req_8"

  case "8" [simulation]
    model ModeLogic, harness HLR_08

suite "Req_9"

  case "9a" [simulation]
    model ModeLogic, harness HLR_09a

  case "9b" [simulation]
    model ModeLogic, harness HLR_09b

  case "9c" [simulation]
    model ModeLogic, harness HLR_09c

  case "9d" [simulation]
    model ModeLogic, harness HLR_09d

  case "9e" [simulation]
    model ModeLogic, harness HLR_09e

suite "Req_10"

  case "10a" [simulation]
    model ModeLogic, harness HLR_10a

  case "10a2" [simulation]
    model ModeLogic, harness HLR_10a2

  case "10b" [simulation]
    model ModeLogic, harness HLR_10b

  case "10c" [simulation]
    model ModeLogic, harness HLR_10c

  case "10d" [simulation]
    model ModeLogic, harness HLR_10d

  case "10d2" [simulation]
    model ModeLogic, harness HLR_10d2

  case "10e" [simulation]
    model ModeLogic, harness HLR_10e

  case "10f" [simulation]
    model ModeLogic, harness HLR_10f

  case "10g" [simulation]
    model ModeLogic, harness HLR_10g

  case "10g2" [simulation]
    model ModeLogic, harness HLR_10g2

  case "10h" [simulation]
    model ModeLogic, harness HLR_10h

  case "10i" [simulation]
    model ModeLogic, harness HLR_10i