% Requirement links of ModeLogic_HLR_Tests.mldatx (R2020b)

item 1 verifies HLR_ModeLogic.slreqx#17: 30: Enter Ready for Flight from Calibration
item 2 verifies HLR_ModeLogic.slreqx#29: 42: Enter Lost Ball from Track Altitude
item 2 verifies HLR_ModeLogic.slreqx#50: 42: Enter Lost Ball from Track Altitude and Position
item 3 verifies HLR_ModeLogic.slreqx#5: 18: Enter Establish Communications from Crash
item 4 verifies HLR_ModeLogic.slreqx#51: 47: Enter Land from Track Altitude and Position
item 5 verifies HLR_ModeLogic.slreqx#42: 51: Enter Crash
item 6 verifies HLR_ModeLogic.slreqx#42: 51: Enter Crash
item 7 verifies HLR_ModeLogic.slreqx#34: 47: Enter Land from Track Altitude
item 8 verifies HLR_ModeLogic.slreqx#42: 51: Enter Crash
item 9 verifies HLR_ModeLogic.slreqx#21: 34: Enter Track Altitude from Ready for Flight
item 9 verifies HLR_ModeLogic.slreqx#48: 35: Enter Track Altitude from Lost Ball
item 10 verifies HLR_ModeLogic.slreqx#30: 43: Enter Land from Lost Ball
item 11 verifies HLR_ModeLogic.slreqx#42: 51: Enter Crash
item 12 verifies HLR_ModeLogic.slreqx#42: 51: Enter Crash
item 13 verifies HLR_ModeLogic.slreqx#51: 47: Enter Land from Track Altitude and Position
item 14 verifies HLR_ModeLogic.slreqx#34: 47: Enter Land from Track Altitude
item 15 verifies HLR_ModeLogic.slreqx#25: 38: The Track Altitude and Position mode shall be entered only from th...
item 15 verifies HLR_ModeLogic.slreqx#49: 39: The Track Altitude and Position mode shall be entered only from th...
item 16 verifies HLR_ModeLogic.slreqx#42: 51: Enter Crash
item 17 verifies HLR_ModeLogic.slreqx#42: 51: Enter Crash
item 18 verifies HLR_ModeLogic.slreqx#42: 51: Enter Crash
item 19 verifies HLR_ModeLogic.slreqx#42: 51: Enter Crash
item 20 verifies HLR_ModeLogic.slreqx#13: 26: Enter Calibrate Sensors from Initialization
item 20 verifies HLR_ModeLogic.slreqx#45: 27: Enter Calibrate Sensors from Ready for Flight
item 21 verifies HLR_ModeLogic.slreqx#42: 51: Enter Crash
item 22 verifies HLR_ModeLogic.slreqx#42: 51: Enter Crash
item 23 verifies HLR_ModeLogic.slreqx#4: 17: Enter Establish Communications at Power Up
item 23 verifies HLR_ModeLogic.slreqx#47: 19: Enter Establish Communications from Land
item 24 verifies HLR_ModeLogic.slreqx#42: 51: Enter Crash
item 25 verifies HLR_ModeLogic.slreqx#9: 22: Enter Initialization from Establish Communications