test file "ModeLogicTest"

suite "ModeLogic"

  case "HLR_02a" [simulation]
    model ModeLogic, harness HLR_02a

  case "HLR_02a_complete" [simulation]
    model ModeLogic, harness HLR_02a_complete

  case "HLR_02a_sldv" [simulation]
    model ModeLogic, harness HLR_02a_sldv

  case "HLR_02b" [simulation]
    model ModeLogic, harness HLR_02b

  case "HLR_03" [simulation]
    model ModeLogic, harness HLR_03

  case "HLR_04" [simulation]
    model ModeLogic, harness HLR_04

  case "HLR_05" [simulation]
    model ModeLogic, harness HLR_05

  case "HLR_06" [simulation]
    model ModeLogic, harness HLR_06

  case "HLR_07" [simulation]
    model ModeLogic, harness HLR_07

  case "HLR_08" [simulation]
    model ModeLogic, harness HLR_08

  case "HLR_09a" [simulation]
    model ModeLogic, harness HLR_09a

  case "HLR_09b" [simulation]
    model ModeLogic, harness HLR_09b

  case "HLR_09c" [simulation]
    model ModeLogic, harness HLR_09c

  case "HLR_09d" [simulation]
    model ModeLogic, harness HLR_09d

  case "HLR_09e" [simulation]
    model ModeLogic, harness HLR_09e

  case "HLR_10a" [simulation]
    model ModeLogic, harness HLR_10a

  case "HLR_10a2" [simulation]
    model ModeLogic, harness HLR_10a2

  case "HLR_10b" [simulation]
    model ModeLogic, harness HLR_10b

  case "HLR_10c" [simulation]
    model ModeLogic, harness HLR_10c

  case "HLR_10c_correct" [simulation]
    model ModeLogic, harness HLR_10c_correct

  case "HLR_10d" [simulation]
    model ModeLogic, harness HLR_10d

  case "HLR_10d2" [simulation]
    model ModeLogic, harness HLR_10d2

  case "HLR_10e" [simulation]
    model ModeLogic, harness HLR_10e

  case "HLR_10f" [simulation]
    model ModeLogic, harness HLR_10f

  case "HLR_10g" [simulation]
    model ModeLogic, harness HLR_10g

  case "HLR_10g2" [simulation]
    model ModeLogic, harness HLR_10g2

  case "HLR_10h" [simulation]
    model ModeLogic, harness HLR_10h

  case "HLR_10i" [simulation]
    model ModeLogic, harness HLR_10i

  case "ModeLogic_Harness" [simulation]
    model ModeLogic, harness ModeLogic_Harness